vi "Append Option.gvi"   [LabVIEW NXG 3.1.0]
inputs:
  "options in": "options.gtype", required
  "propertiesJSON": string, required
outputs:
  "options out": "options.gtype"
types:
  "option.gtype" = cluster{"propertiesJSON": string}
  "options.gtype" = "option.gtype"[]
diagram:
  Property Node(instance in="option.gtype" {all zero or empty}, "propertiesJSON"=$propertiesJSON) -> (instance out=w1)
  Build Array($"options in", w1) -> w2
  $"options out" <- w2
