vi "HMI.gviweb"   [LabVIEW NXG 5.0.0]
panel controls:
  "Pi (cmH2O)": f64 = 15
  "EDIT MODE": enum{"V A/C", "P A/C", "PSV", "VSIMV", "PSIMV"} = "P A/C"
  "PEEP (cmH2O)": f64 = 5
  "Rate": f64 = 13
  "Start": bool
  "Rise Time": f64 = 2
  "Insp. Time": f64 = 1.5
  "I Sense": f64 = 3
  "Vt Target": f64 = 400
  "SilenceAL": bool
  "PauseAL": bool
  "Freeze Graphs": bool
  "Change Mode": bool
  "URL": string = "http://127.0.0.1:8001/WebService1/"
  "Rate_2": f64 = 13
  "PIP (cmH2O)": f64 = 5
  "PIP (cmH2O)_3": f64 = 5
  "PIP (cmH2O)_4": f64
  "PIP (cmH2O)_6": f64 = 5
  "PIP (cmH2O)_7": f64 = 5
  "PIP (cmH2O)_9": f64 = 5
  "PIP (cmH2O)_10": f64 = 5
  "PIP (cmH2O)_12": f64
  "Alarm": bool
  "Waveform": bool
  "Alarm Log": bool
  "Back to Ventilation_3": bool
  "Back to Ventilation_2": bool
  "Apnea Alarm": enum{"YES", "NO"} = "YES"
  "Pediatric Circuite": enum{"YES", "NO"} = "YES"
  "Back from Report to Ventilation": bool
  "Back from Alarm Log to Alarm": bool
  "Report": bool
  "Pi (cmH2O)_2": f64 = 15
  "EDIT MODE_2": enum{"V A/C", "P A/C", "PSV", "VSIMV", "PSIMV"} = "P A/C"
  "PEEP (cmH2O)_2": f64 = 5
  "Rate_5": f64 = 13
  "Start_2": bool
  "Rise Time_2": f64 = 2
  "Insp. Time_2": f64 = 1.5
  "I Sense_2": f64 = 3
  "Vt Target_2": f64 = 400
  "Change Mode_2": bool
  "Rate_6": f64 = 13
  "Alarm_3": bool
  "Waveform_2": bool
  "Preference_2": bool
  "Setup_2": bool
  "PIP (cmH2O)_13": f64 = 5
  "PIP (cmH2O)_14": f64 = 5
  "PIP (cmH2O)_15": f64 = 5
  "PIP (cmH2O)_16": f64
  "PIP (cmH2O)_17": f64 = 5
  "PIP (cmH2O)_18": f64 = 5
  "PIP (cmH2O)_19": f64 = 5
  "PIP (cmH2O)_20": f64
  "PIP (cmH2O)_21": f64 = 5
  "PIP (cmH2O)_22": f64 = 5
  "PIP (cmH2O)_23": f64 = 5
  "PIP (cmH2O)_24": f64
  "Ventilation_7": bool
  "Alarm Log_2": bool
  "PressureChart_2": f64[]
  "FlowChart_2": f64[]
  "VolumeChart_2": f64[]
  "Freeze Graphs_2": bool
  "Ventilation_8": bool
  "Date_2": string = "27-08-2020"
  "Time_2": string = "11:50:55"
  "Machine Hour_2": string
  "Patient Hour_2": string = "1:30:88"
  "Pressure Settings_2": enum{"RELATIVE", "ABSOLUTE"} = "RELATIVE"
  "Reset Patient Hour_2": bool
  "Ventilation_9": bool
  "Maintanance_2": bool
  "Calibration_2": bool
  "Ventilation Report_2": i32 = -1
  "Pediatric Circuite_2": enum{"YES", "NO"} = "YES"
  "Apnea Alarm_2": enum{"YES", "NO"} = "YES"
  "Ventilation_10": bool
  "Patient Pressure_2": cluster{"Slope(M)": f64, "Intercept(c)": f64} = {"Slope(M)"=5, "Intercept(c)"=5}
  "Insp Valve Pressure_2": cluster{"Slope(M)": f64, "Intercept(c)": f64} = {"Slope(M)"=5, "Intercept(c)"=5}
  "Insp Flow_2": cluster{"Slope(M)": f64, "Intercept(c)": f64} = {"Slope(M)"=5, "Intercept(c)"=5}
  "Exhalation flow_2": cluster{"Slope(M)": f64, "Intercept(c)": f64} = {"Slope(M)"=5, "Intercept(c)"=5}
  "Fio2_2": cluster{"Slope(M)": f64, "Intercept(c)": f64} = {"Slope(M)"=5, "Intercept(c)"=5}
  "Ventilation_11": bool
  "Fault Check list_2": i32 = -1
  "Software Version No_2": string = "3455X776"
  "Serial No_2": string = "3465546"
  "Turbine Speed Test_2": string
  "Rate_7": f64 = 13
  "UP_2": bool
  "Down_2": bool
  "Max_2": bool
  "Altitude Settinds_2": enum{"YES", "NO"} = "YES"
  "Rate_8": f64 = 13
  "Ventilation_12": bool
  "Alarm Log List_2": i32 = -1
  "Alarm_4": bool
panel indicators:
  "Tab": i32
  "cmH2O": f64
  "VtI (mL)": f64
  "VtE (mL)": f64
  "M Vol (L)": f64
  "Rate (bpm)": f64
  "I": f64
  "FiO2 (%)": f64
  "E": f64
  "Active Mode": string
  "Pressure": string
  "Last Alarm": string
  "Status": string
  "PressureChart": f64[]
  "FlowChart": f64[]
  "VolumeChart": f64[]
  "value": cluster{"Acknowledged": bool}
  "body": string
  "PIP (cmH2O)_2": f64
  "PIP (cmH2O)_5": f64
  "PIP (cmH2O)_8": f64
  "PIP (cmH2O)_11": f64
  "Ventilation Report": i32
  "Alarm Log List": i32
  "Text_2": string[]
types:
  T1 = cluster{"M Vol (L)": f64, "VtI (mL)": f64, "Rate (bpm)": f64, "E": f64, "cmH2O": f64, "VtE (mL)": f64, "Pressure": f64[], "Flow": f64[], "Volume": f64[]}
  T2 = cluster{"Rate": f64, "Insp. Time": f64, "Pi (cmH2O)": f64, "PEEP (cmH2O)": f64, "Vt Target": f64}
uses:
  NI::HTTP::GET.gvi
  NI::HTTP::POST Buffer.gvi
  WebApp::Keypad.gvi
diagram:
  Build Array(reference to "Alarm", reference to "Waveform", reference to "Report") -> w1
  Build Array(reference to "Vt Target", reference to "Pi (cmH2O)", reference to "Insp. Time", reference to "Rise Time", reference to "Rate", reference to "I Sense", reference to "PEEP (cmH2O)", reference to "Rate_2") -> w2
  Property Node(instance in=reference to "Tab", "Value"=0) -> (instance out=w3)
  Property Node(instance in=reference to "Start", "KeyFocus"=FALSE) -> (error out=w4)
  s1 = w3  # shift register
  while (after w4) (after 0) {
    w5 = $URL
    event (timeout = 200) {
      on "Timeout" {
        disable {
          frame Enabled {
            w7 = default
          }
          frame Disabled {
            Property Node(instance in=cluster{"HMI": u16} {all zero or empty}, "HMI"=$"EDIT MODE") -> (instance out=w8)
            Flatten To Json(anything=w8) -> (JSON string=w9, error out=w7)
          }
        }
        Concatenate Strings(w5, "General") -> w10
        call "GET.gvi"(timeout=100, url=w10, error in=w7) -> (body=w11, error out=w12)
        Unflatten From Json(JSON string=w11, error in (no error)=w12, type and defaults=T1 {all zero or empty}) -> (value=w13)
        Property Node(instance in=w13) -> ("M Vol (L)"=w14, "VtI (mL)"=w15, "Rate (bpm)"=w16, "E"=w17, "cmH2O"=w18, "VtE (mL)"=w19, "Pressure"=w20, "Flow"=w21, "Volume"=w22)
        $"M Vol (L)" <- w14
        $"VtI (mL)" <- w15
        $"Rate (bpm)" <- w16
        $E <- w17
        $cmH2O <- w18
        case ($"Freeze Graphs") {
          frame True { }
          frame False {
            $PressureChart <- w20
            $FlowChart <- w21
            $VolumeChart <- w22
          }
        }
        $"VtE (mL)" <- w19
        w6 = s1
      }
      on "Insp. Time" Value changed; "PEEP (cmH2O)" Value changed; "Pi (cmH2O)" Value changed; "Rate" Value changed; "Vt Target" Value changed {
        Concatenate Strings(w5, "UpdatePara") -> w23
        Property Node(instance in=T2 {all zero or empty}, "Rate"=$Rate, "Insp. Time"=$"Insp. Time", "Pi (cmH2O)"=$"Pi (cmH2O)", "PEEP (cmH2O)"=$"PEEP (cmH2O)", "Vt Target"=$"Vt Target") -> (instance out=w24)
        Flatten To Json(anything=w24) -> (JSON string=w25, error out=w26)
        call "POST Buffer.gvi"(url=w23, buffer=w25, error in=w26, timeout=100) -> (body=w27, error out=w28)
        $body <- w27
        Unflatten From Json(JSON string=w27, error in (no error)=w28, type and defaults=cluster{"Acknowledged": bool} {all zero or empty}) -> (value=w29)
        $value <- w29
        w6 = s1
      }
      on "Alarm" Value changed {
        Property Node(instance in=s1, "Value"=1) -> (instance out=w6)
        Property Node(instance in=reference to "Alarm")
        call "Keypad.gvi"()
      }
      on "Waveform" Value changed {
        Property Node(instance in=s1, "Value"=2) -> (instance out=w6)
      }
      on "Alarm Log" Value changed {
        Property Node(instance in=s1, "Value"=7) -> (instance out=w6)
      }
      on "Back to Ventilation_3" Value changed {
        Property Node(instance in=s1, "Value"=0) -> (instance out=w6)
      }
      on "Back to Ventilation_2" Value changed {
        Property Node(instance in=s1, "Value"=0) -> (instance out=w6)
      }
      on "Back from Alarm Log to Alarm" Value changed {
        Property Node(instance in=s1, "Value"=1) -> (instance out=w6)
      }
      on "Start" Value changed {
        Event Data() -> ("Control Reference"=w30, "New Value"=w31)
        case (w31) {
          frame False {
            Property Node(instance in=w30) -> ("Text"=w33)
            $Text_2 <- w33
            for {
              w34 = each element of w1
              w35 = each element of [TRUE, TRUE, FALSE, FALSE]
              Property Node(instance in=w34, "Disabled"=w35)
            }
            w32 = "-"
          }
          frame True {
            Property Node(instance in=reference to "EDIT MODE") -> ("Value"=w36)
            Format Into String(w36) -> w32
            Property Node(instance in=w30) -> ("Text"=w37)
            for {
              w38 = each element of w1
              w39 = each element of [FALSE, FALSE, TRUE, TRUE]
              Property Node(instance in=w38, "Disabled"=w39)
            }
          }
        }
        $"Active Mode" <- w32
        w6 = s1
      }
      on "Report" Value changed {
        Property Node(instance in=s1, "Value"=4) -> (instance out=w6)
      }
      on "Calibration" Value changed; "Maintanance" Value changed; "Setup" Value changed; "Ventilation_3" Value changed; "Ventilation_5" Value changed; "Ventilation_6" Value changed; "Back from Report to Ventilation" Value changed {
        Event Data() -> ("Control Reference"=w40)
        Property Node(instance in=w40) -> ("Text"=w41)
        Array Index(array=w41) -> (out0[0]=w42)
        case (w42) {
          frame "Ventilationa" {
            w43 = 0
          }
          frame "Calibration" {
            w43 = 5
          }
          frame "Maintanance" {
            w43 = 6
          }
          frame "Ventilationb" {
            w43 = 0
          }
          frame "Ventilation_5" {
            w43 = 0
          }
          frame "Ventilation_6" {
            w43 = 0
          }
          frame "Setup", Default {
            w43 = 3
          }
        }
        Property Node(instance in=s1, "Value"=w43) -> (instance out=w6)
      }
      on "EDIT MODE" Value changed {
        Event Data() -> ("New Value"=w44)
        case (w44) {
          frame "V A/C", Default {
            w46 = ["Vt", "PIP", "Insp Time", "Ramp Pattern", "Rate", "I Sense", "NA", "NA"]
            w45 = w46
          }
          frame "P A/C" {
            w47 = ["Pi (cmH2O)", "PEEP", "Rise time", "Insp time", "Rate", "I Sense", "NA", "NA"]
            w45 = w47
          }
          frame "PSV" {
            w48 = ["P support", "PEEP", "Rise time", "Min I time", "Max I time", "I Sense", "E Sense", "Apnea time"]
            w45 = w48
          }
          frame "VSIMV" {
            w49 = ["Vt", "PEEP", "Rise time", "P support", "Rate", "I Sense", "E Sense", "Insp time"]
            w45 = w49
          }
          frame "PSIMV" {
            w50 = ["Pi", "PEEP", "Rise time", "P support", "Rate", "I Sense", "E Sense", "Insp time"]
            w45 = w50
          }
        }
        for {
          w51 = each element of w45
          w52 = each element of w2
          Property Node(instance in=w52) -> ("Label"=w53)
          Property Node(instance in=w53, "Text"=w51)
        }
        w6 = s1
      }
    }
    next s1 = w6
    stop if FALSE
  }
  for {
    w54 = each element of w1
    w55 = each element of [TRUE, TRUE, FALSE, FALSE]
    Property Node(instance in=w54, "Disabled"=w55)
  }
  $Tab <- 0
