vi "Index.gviweb"   [LabVIEW NXG 5.0.0]
panel controls:
  "Pi (cmH2O)": u32 = 15
  "MODE": enum{"V A/C", "P A/C", "PSV", "VSIMV", "PSIMV"} = "P A/C"
  "PEEP (cmH2O)": f64 = 5
  "Rate": f64 = 13
  "Start": bool
  "Rise Time": f64 = 2
  "Insp. Time": f64 = 1.5
  "I Sense": f64 = 3
  "Vt Target": f64 = 400
  "PauseAL": bool
  "Freeze Graphs": bool
  "Edit and Apply": bool
  "URL": string = "http://127.0.0.1:8001/WebService1/"
  "Rate_2": f64 = 13
  "PIP (cmH2O)": f64 = 5
  "Set Alarm": bool
  "Back to Ventilation_4": bool
  "Alarm": bool
  "Reports": bool
  "Pi (cmH2O)_2": f64 = 15
  "EDIT MODE_2": enum{"V A/C", "P A/C", "PSV", "VSIMV", "PSIMV"} = "P A/C"
  "PEEP (cmH2O)_2": f64 = 5
  "Rate_5": f64 = 13
  "Start_2": bool
  "Rise Time_2": f64 = 2
  "Insp. Time_2": f64 = 1.5
  "I Sense_2": f64 = 3
  "Vt Target_2": f64 = 400
  "Change Mode_2": bool
  "Rate_6": f64 = 13
  "Alarm_3": bool
  "Waveform_2": bool
  "Preference_2": bool
  "Setup_2": bool
  "PIP (cmH2O)_13": f64 = 5
  "PIP (cmH2O)_14": f64 = 5
  "PIP (cmH2O)_15": f64 = 5
  "PIP (cmH2O)_16": f64
  "PIP (cmH2O)_17": f64 = 5
  "PIP (cmH2O)_18": f64 = 5
  "PIP (cmH2O)_19": f64 = 5
  "PIP (cmH2O)_20": f64
  "PIP (cmH2O)_21": f64 = 5
  "PIP (cmH2O)_22": f64 = 5
  "PIP (cmH2O)_23": f64 = 5
  "PIP (cmH2O)_24": f64
  "Ventilation_7": bool
  "Alarm Log_2": bool
  "PressureChart_2": f64[]
  "FlowChart_2": f64[]
  "VolumeChart_2": f64[]
  "Freeze Graphs_2": bool
  "Ventilation_8": bool
  "Date_2": string = "27-08-2020"
  "Time_2": string = "11:50:55"
  "Machine Hour_2": string
  "Patient Hour_2": string = "1:30:88"
  "Pressure Settings_2": enum{"RELATIVE", "ABSOLUTE"} = "RELATIVE"
  "Reset Patient Hour_2": bool
  "Ventilation_9": bool
  "Maintanance_2": bool
  "Calibration_2": bool
  "Ventilation Report_2": i32 = -1
  "Pediatric Circuite_2": enum{"YES", "NO"} = "YES"
  "Apnea Alarm_2": enum{"YES", "NO"} = "YES"
  "Ventilation_10": bool
  "Patient Pressure_2": cluster{"Slope(M)": f64, "Intercept(c)": f64} = {"Slope(M)"=5, "Intercept(c)"=5}
  "Insp Valve Pressure_2": cluster{"Slope(M)": f64, "Intercept(c)": f64} = {"Slope(M)"=5, "Intercept(c)"=5}
  "Insp Flow_2": cluster{"Slope(M)": f64, "Intercept(c)": f64} = {"Slope(M)"=5, "Intercept(c)"=5}
  "Exhalation flow_2": cluster{"Slope(M)": f64, "Intercept(c)": f64} = {"Slope(M)"=5, "Intercept(c)"=5}
  "Fio2_2": cluster{"Slope(M)": f64, "Intercept(c)": f64} = {"Slope(M)"=5, "Intercept(c)"=5}
  "Ventilation_11": bool
  "Fault Check list_2": i32 = -1
  "Software Version No_2": string = "3455X776"
  "Serial No_2": string = "3465546"
  "Turbine Speed Test_2": string
  "Rate_7": f64 = 13
  "UP_2": bool
  "Down_2": bool
  "Max_2": bool
  "Altitude Settinds_2": enum{"YES", "NO"} = "YES"
  "Rate_8": f64 = 13
  "Ventilation_12": bool
  "Alarm Log List_2": i32 = -1
  "Alarm_4": bool
  "Export report": bool
  "timeout": i32 = 100
  "PIP (cmH2O)_3": f64 = 5
  "PIP (cmH2O)_4": f64 = 5
  "PIP (cmH2O)_6": f64 = 5
  "PIP (cmH2O)_9": f64 = 5
  "PIP (cmH2O)_10": f64 = 5
  "PIP (cmH2O)_11": f64 = 5
  "PIP (cmH2O)_12": f64 = 5
  "Switch": bool
  "Alarm Log": bool
  "Back to Ventilation": bool
  "Button": bool
  "Button_2": bool
  "Prompt": bool = TRUE
  "prompt message": string = "This is a simple prompt!"
  "prompt default": string = "one nice default"
panel indicators:
  "VtI (mL)": f64
  "VtE (mL)": f64
  "M Vol (L)": f64
  "Rate (bpm)": f64
  "I": f64
  "FiO2 (%)": f64
  "E": f64
  "Active Mode": string
  "Pressure": string
  "Last Alarm": string
  "PressureChart": f64
  "FlowChart": f64
  "Post value": cluster{"Acknowledged": bool}
  "body": string
  "PIP (cmH2O)_2": f64
  "Alarm Log List": i32
  "PIP": f64
  "PEEP": f64
  "Current": f64
  "Ventilation time": string
  "Date": string
  "Vte": string
  "Vti": string
  "Spontaneous Breath": string
  "Paw": string
  "Apnea Ti": string
  "Rate_3": string
  "Machine Hour": string
  "Patient Hour": string
  "Status_2": string
  "product": f64
  "Get body": string
  "loop iteration": i32
  "JSON string to Post": string
  "URL_2": string
  "headers": string
  "Current_2": f64
  "Tab_2": i32
  "PIP (cmH2O)_5": f64
  "PIP (cmH2O)_7": f64
  "PIP (cmH2O)_8": f64
  "Tab_3": i32
  "Status_3": string
  "prompt value": string
  "prompt cancelled?": bool
  "URL Image": string
  "URL Image_2": string
  "URL Image_3": string
types:
  T1 = cluster{"M Vol (L)": f64, "VtI (mL)": f64, "Rate (bpm)": f64, "E": f64, "cmH2O": f64, "VtE (mL)": f64, "Pressure": f64[], "Flow": f64[], "Volume": f64[]}
  T2 = cluster{"Rate": f64, "Insp. Time": f64, "Pi (cmH2O)": f64, "PEEP (cmH2O)": f64, "Vt Target": f64}
uses:
  NI::HTTP::GET.gvi
  NI::HTTP::POST Buffer.gvi
  SweetAlert::Prompt.gvi
  WebApp::Keypad.gvi
diagram:
  Build Array(reference to "Set Alarm", reference to "Reports", reference to "Edit and Apply", reference to "MODE") -> w1
  Build Array(reference to "Vt Target", reference to "Pi (cmH2O)", reference to "Insp. Time", reference to "Rise Time", reference to "Rate", reference to "I Sense", reference to "PEEP (cmH2O)", reference to "Rate_2") -> w2
  Build Array(reference to "Start", reference to "Edit and Apply") -> w3
  for {
    w4 = each element of w3
    Property Node(instance in=w4, "Value"=FALSE) -> (error out=w6)
    append w6 to w5
  }
  Property Node(instance in=reference to "Tab_2", "Value"=0) -> (instance out=w7)
  s1 = w7  # shift register
  s2 = uninitialised  # shift register
  while (iteration -> i1) (after w5) {
    w8 = $URL
    event (timeout = 200) {
      on "Timeout" {
        disable {
          frame Enabled {
            w11 = default
          }
          frame Disabled {
            Property Node(instance in=cluster{"HMI": u16} {all zero or empty}, "HMI"=$MODE) -> (instance out=w12)
            Flatten To Json(anything=w12) -> (JSON string=w13, error out=w11)
          }
        }
        Concatenate Strings(w8, "General") -> w14
        call "GET.gvi"(timeout=$timeout, url=w14, error in=w11) -> (headers=w15, body=w16, error out=w17)
        $headers <- w15
        Unflatten From Json(JSON string=w16, error in (no error)=w17, type and defaults=T1 {all zero or empty}) -> (value=w18)
        Property Node(instance in=w18) -> ("M Vol (L)"=w19, "VtI (mL)"=w20, "Rate (bpm)"=w21, "E"=w22, "VtE (mL)"=w23, "Pressure"=w24, "Flow"=w25, "Volume"=w26)
        $"M Vol (L)" <- w19
        $"VtI (mL)" <- w20
        $"Rate (bpm)" <- w21
        $E <- w22
        $URL_2 <- w14
        $"Get body" <- w16
        Random Number() -> (number (0 to 1)=w27)
        Multiply(w27, 10) -> w28
        case ($"Freeze Graphs") {
          frame True { }
          frame False {
            $PressureChart <- w28
            $FlowChart <- w28
          }
        }
        $"VtE (mL)" <- w23
        $product <- w28
        w9 = s1
        w10 = s2
      }
      on "Insp. Time" Value changed; "PEEP (cmH2O)" Value changed; "Pi (cmH2O)" Value changed; "Rate" Value changed; "Vt Target" Value changed {
        Concatenate Strings(w8, "UpdatePara") -> w29
        Property Node(instance in=T2 {all zero or empty}, "Rate"=$Rate, "Insp. Time"=$"Insp. Time", "Pi (cmH2O)"=$"Pi (cmH2O)", "PEEP (cmH2O)"=$"PEEP (cmH2O)", "Vt Target"=$"Vt Target") -> (instance out=w30)
        Flatten To Json(anything=w30) -> (JSON string=w31, error out=w32)
        call "POST Buffer.gvi"(url=w29, buffer=w31, error in=w32, timeout=100) -> (body=w33, error out=w34)
        $body <- w33
        Unflatten From Json(JSON string=w33, error in (no error)=w34, type and defaults=cluster{"Acknowledged": bool} {all zero or empty}) -> (value=w35)
        $"Post value" <- w35
        $"JSON string to Post" <- w31
        w9 = s1
        w10 = default
      }
      on "Start" Value changed {
        Event Data() -> ("Control Reference"=w36, "New Value"=w10)
        case (w10) {
          frame False {
            for {
              w38 = each element of w2
              Property Node(instance in=w38, "Disabled"=FALSE)
            }
            Build Array("Activate") -> w39
            Property Node(instance in=w36, "Text"=w39)
            Property Node(instance in=reference to "MODE", "Disabled"=FALSE)
            for {
              w40 = each element of w1
              w41 = each element of [FALSE, FALSE, FALSE, FALSE]
              Property Node(instance in=w40, "Disabled"=w41)
            }
            w37 = "-"
          }
          frame True {
            for {
              w42 = each element of w2
              Property Node(instance in=w42, "Disabled"=TRUE)
            }
            Property Node(instance in=reference to "MODE") -> ("Value"=w43)
            Format Into String(w43) -> w37
            Property Node(instance in=reference to "MODE", "Disabled"=TRUE)
            Build Array("Stand by") -> w44
            Property Node(instance in=w36, "Text"=w44)
            for {
              w45 = each element of w1
              w46 = each element of [FALSE, FALSE, FALSE, TRUE]
              Property Node(instance in=w45, "Disabled"=w46)
            }
          }
        }
        $"Active Mode" <- w37
        w9 = s1
      }
      on "Set Alarm" Value changed; "Alarm Log" Value changed; "Alarm" Value changed; "Back to Ventilation" Value changed; "Back to Ventilation_4" Value changed; "Reports" Value changed {
        Event Data() -> ("Control Reference"=w47)
        Property Node(instance in=w47) -> ("Text"=w48)
        Array Index(array=w48) -> (out0[0]=w49)
        case (w49) {
          frame "Set Alarm" {
            w50 = 1
          }
          frame "Alarm Log" {
            w50 = 2
          }
          frame "Alarm" {
            w50 = 1
          }
          frame "Back to Ventilation", "Back to Ventilation_4", Default {
            w50 = 0
          }
          frame "Reports" {
            w50 = 3
          }
        }
        Property Node(instance in=s1, "Value"=w50) -> (instance out=w9)
        w10 = default
      }
      on "MODE" Value changed {
        case (s2) {
          frame True {
            Property Node(instance in=reference to "Edit and Apply", "Disabled"=FALSE)
          }
          frame False {
            Property Node(instance in=reference to "Edit and Apply", "Disabled"=TRUE)
          }
        }
        Event Data() -> ("New Value"=w51)
        case (w51) {
          frame "V A/C", Default {
            w53 = ["Vt", "PIP", "Insp Time", "Ramp Pattern", "Rate", "I Sense", "NA", "NA"]
            w52 = w53
          }
          frame "P A/C" {
            w54 = ["Pi (cmH2O)", "PEEP", "Rise time", "Insp time", "Rate", "I Sense", "NA", "NA"]
            w52 = w54
          }
          frame "PSV" {
            w55 = ["P support", "PEEP", "Rise time", "Min I time", "Max I time", "I Sense", "E Sense", "Apnea time"]
            w52 = w55
          }
          frame "VSIMV" {
            w56 = ["Vt", "PEEP", "Rise time", "P support", "Rate", "I Sense", "E Sense", "Insp time"]
            w52 = w56
          }
          frame "PSIMV" {
            w57 = ["Pi", "PEEP", "Rise time", "P support", "Rate", "I Sense", "E Sense", "Insp time"]
            w52 = w57
          }
        }
        for {
          w58 = each element of w52
          w59 = each element of w2
          Property Node(instance in=w59) -> ("Label"=w60)
          Property Node(instance in=w60, "Text"=w58)
        }
        w9 = s1
        w10 = s2
      }
      on "Edit and Apply" Value changed {
        Event Data() -> ("Control Reference"=w61, "New Value"=w62)
        case (w62) {
          frame True {
            Build Array("Apply") -> w63
            Property Node(instance in=w61, "Text"=w63)
            for {
              w64 = each element of w2
              Property Node(instance in=w64, "Disabled"=FALSE)
            }
            Property Node(instance in=reference to "MODE", "Disabled"=FALSE)
          }
          frame False {
            Build Array("Edit") -> w65
            Property Node(instance in=w61, "Text"=w65)
            for {
              w66 = each element of w2
              Property Node(instance in=w66, "Disabled"=TRUE)
            }
            Property Node(instance in=reference to "MODE", "Disabled"=TRUE)
            Property Node(instance in=reference to "MODE") -> ("Value"=w67)
            Format Into String(w67) -> w68
            Property Node(instance in=reference to "Active Mode", "Value"=w68)
          }
        }
        w9 = s1
        w10 = s2
      }
      on "Prompt" Value changed {
        call "Prompt.gvi"(message=$"prompt message", default=$"prompt default") -> (value=w69, cancelled?=w70)
        $"prompt value" <- w69
        $"prompt cancelled?" <- w70
        w9 = default
        w10 = default
      }
      on "Button_2" Value changed {
        Event Data() -> ("New Value"=w71)
        Select(s=w71, t=1, f=0) -> w72
        $Tab_3 <- w72
        w9 = default
        w10 = default
      }
    }
    $"loop iteration" <- i1
    next s1 = w9
    next s2 = w10
    stop if FALSE
  }
  for {
    w73 = each element of w1
    w74 = each element of [FALSE, FALSE, FALSE, FALSE, FALSE]
    Property Node(instance in=w73, "Disabled"=w74)
  }
  call "Keypad.gvi"()
