vi "Simulate Top level.gviweb"   [LabVIEW NXG 5.0.0]
panel controls:
  "Pressure": f64
  "I:E": f64
  "I:E_2": f64
  "I:E_3": f64
  "I:E_4": f64
  "I:E_5": f64
  "I:E_6": f64
  "Tab": i32
  "Hyperlink Control": string = "HMI.html"
panel indicators:
  "LED": bool
  "LED_2": bool
  "LED_3": bool
  "I:E_7": f64
  "I:E_8": f64
  "I:E_9": f64
  "I:E_10": f64
  "I:E_11": f64
  "I:E_12": f64
  "Chart": f64
  "Chart_2": f64
diagram:
  # Place setup code before the loop. For example, perform initial data communication and wire the results into the loop.
  # Top-Level WebVIs usually contain a While Loop that never stops so that they can continue running as long as the web page is open in the user's web browser.
  s1 = FALSE  # shift register
  while {
    Random Number() -> (number (0 to 1)=w1)
    Multiply(w1, 50) -> w2
    Is Greater(x=w2, y=25) -> w3
    Not(x=w3) -> w4
    $LED <- w4
    $LED_2 <- w3
    Not(x=s1) -> w5
    $LED_3 <- w5
    $Chart <- w2
    Multiply(w1, $Pressure) -> w6
    $Chart_2 <- w6
    Wait(time to wait=50)
    Add(w1, $"I:E") -> w7
    $"I:E_10" <- w7
    Add($"I:E_2", w6) -> w8
    $"I:E_11" <- w8
    Multiply(w1, 200) -> w9
    Add(w9, $"I:E_3") -> w10
    $"I:E_12" <- w10
    Add($"I:E_4", w6) -> w11
    $"I:E_7" <- w11
    Add($"I:E_5", $"I:E") -> w12
    $"I:E_8" <- w12
    Add($"I:E_6", w12) -> w13
    $"I:E_9" <- w13
    next s1 = w5
    stop if FALSE
  }
