vi "indexold.gviweb"   [LabVIEW NXG 5.0.0]
panel controls:
  "Tab": i32
  "Pi (cmH2O)": f64 = 15
  "EDIT MODE": enum{"P A/C", "V A/C", "PSV", "VSIMV", "PSIMV"} = "P A/C"
  "PEEP (cmH2O)": f64 = 5
  "Rate": f64 = 13
  "Start": bool
  "Rise Time": f64 = 2
  "Insp. Time": f64 = 1.5
  "I Sense": f64 = 3
  "Vt Target": f64 = 400
  "SilenceAL": bool
  "PauseAL": bool
  "Freeze Graphs": bool
  "Change Mode": bool
panel indicators:
  "cmH2O": f64
  "VtI (mL)": f64
  "VtE (mL)": u32
  "M Vol (L)": f64
  "Rate (bpm)": f64
  "I": f64
  "FiO2 (%)": f64
  "E": f64
  "Active Mode": string
  "Pressure": string
  "Last Alarm": string
  "HPA": bool
  "MPA": bool
  "Status": string
  "Chart": f64
  "Chart_2": f64
  "Chart_3": f64
diagram:
  s1 = uninitialised  # shift register
  s2 = 0  # shift register
  s3 = 0  # shift register
  s4 = 0  # shift register
  while {
    # w1: In Time
    Multiply(1000, $"Insp. Time") -> w1
    Divide(x=60, y=$Rate) -> w2
    Subtract(x=w2, y=$"Insp. Time") -> w3
    Divide(x=w3, y=$"Insp. Time") -> w4
    # w5: Ex Time
    Multiply(w3, 1000) -> w5
    case ($Start) {
      frame False, Default {
        Tick Count() -> (timer value=w6)
        w7 = "-"
        w8 = 0
        w9 = 0
        w10 = 0
        w11 = FALSE
      }
      frame True {
        $E <- w4
        Tick Count() -> (timer value=w12)
        Subtract(x=w12, y=s1) -> w13
        To Double Precision Float(number=w13) -> w14
        Is Less(x=w1, y=w14) -> w15
        Divide(x=w5, y=100) -> w16
        Divide(x=$"Vt Target", y=w16) -> w17
        Divide(x=w1, y=100) -> w18
        Divide(x=$"Vt Target", y=w18) -> w19
        case (w15) {
          frame False, Default {
            # Inhalation
            Add(s2, w19) -> w21
            $"VtI (mL)" <- w21
            w20 = $"Pi (cmH2O)"
            w9 = w21
          }
          frame True {
            # Exhalation
            Subtract(x=s2, y=w17) -> w21
            To Unsigned 32 Bit Integer(number=w21) -> w9
            $"VtE (mL)" <- w9
            w20 = $"PEEP (cmH2O)"
          }
        }
        Add(w1, w5) -> w22
        To Double Precision Float(number=w13) -> w23
        Is Less(x=w22, y=w23) -> w24
        Select(s=w24, t=0, f=w21) -> w8
        $"Rate (bpm)" <- $Rate
        Subtract(x=w9, y=s3) -> w25
        Divide(x=w25, y=100) -> w26
        case ($"Freeze Graphs") {
          frame True { }
          frame False {
            $Chart <- w20
            $Chart_2 <- w26
            $Chart_3 <- w9
          }
        }
        $cmH2O <- w20
        Select(s=w24, t=w12, f=s1) -> w6
        Format Into String($"EDIT MODE") -> w7
        Add(s4, $"Vt Target") -> w27
        Select(s=w24, t=w27, f=s4) -> w28
        Divide(x=w28, y=1000) -> w10
        $"M Vol (L)" <- w10
        w11 = TRUE
      }
    }
    $"Active Mode" <- w7
    Property Node(instance in=reference to "Change Mode", "Visible"=w11)
    Wait(time to wait=100)
    next s1 = w6
    next s2 = w8
    next s3 = w9
    next s4 = w10
    stop if FALSE
  }
